# Grasshopper definition 700_nesting_guid_transformation.ghx (Grasshopper 1.0.8)
# plug-ins: opennest_2 Info

id = Guid([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])
geometry_rhino = GeometryRhino(Layer="Outline", Copies="1", Simplify=[100, 0], Sort=Slider(0, range=-1..1), Guid=id)  # -> Geometry, Borders, BC, Groups, All

crv = Curve(<curve referenced from the Rhino model>)
sheets = Sheets(Polylines=crv, Gap=0.1)  # -> Sheets, Polylines
opennest2 = OpenNest2(
    Sheets=sheets.Sheets,
    Geometry=geometry_rhino.Geometry,
    Options=["num_of_rotations 4", "wiggle 0", "placement_type 0", "spacing 0.0", "seed 30", "simplify_tolerance 1", "mutation 10", "population 10000", "time 0", "MecSoft_Font-1 1"],
    Iterations=1,
    Run=Toggle(True))  # -> Sheets, Borders, AllGeometry, Transforms, SheetId, SheetTxt, Attributes
item = ListItem(List=id, Index=geometry_rhino.Groups, Wrap=True)
geo = Geometry(opennest2.AllGeometry)
tguid = TransformGuid(Guid=item, Transform=opennest2.Transforms, Run=Toggle(False))
